# Dynamo graph class-create.dyn (Dynamo 2.0.2.6826)

# group: Get element types used in model
categories = Categories(index=589)  # graph input
all_elements_of_category = ElementsOfCategory(Category=categories)
type = archilab.Revit.Elements.Elements.Type(element=all_elements_of_category)
uniqueItems = List.UniqueItems(list=type)

# group: Generate triples for class create
class_namespace = CodeBlock { "http://localhost:3000/duplex/arch/ontology/"; }
superclass_namespace = CodeBlock { ["bot", "https://w3id.org/bot#"]; }
superclass = CodeBlock { "bot:Element"; }
# note: [0] Class namespace
# [1] Superclass namespace
# [2] Super class
# [3] Classes
create_class = Python(IN[0]=class_namespace, IN[1]=superclass_namespace, IN[2]=superclass, IN[3]=uniqueItems)
# ---------- create_class.python (43 lines) ----------
import sys
sys.path.append(r'C:\Program Files (x86)\IronPython 2.7\Lib')
import urllib

#The inputs to this node will be stored as a list in the IN variables.
classNS = 		IN[0]
superClassPFX = IN[1][0]
superClassNS = 	IN[1][1]
superClass = 	IN[2]
classes =		IN[3]

def _get_id_name(e):
	# Make lowercase and replace æ, ø, å
	n = e.Name.lower()
	n = n.replace('æ', 'ae').replace('ø', 'oe').replace('å', 'aa')
	# Make PascalCaseName
	n = ''.join(x for x in n.title() if x.isalnum())
	# URL encode
	n = urllib.quote(n)
	return n

# PREFIXES
str = "@prefix ont: <%s> .\n" % classNS
str+= "@prefix owl: <http://www.w3.org/2002/07/owl#> .\n"
str+= "@prefix rdfs: <http://www.w3.org/2000/01/rdf-schema#> .\n"
str+= "@prefix %s: <%s> .\n\n" % (superClassPFX, superClassNS)

# INSTANCES
seen = set()
err = False
for c in classes:
	# Make PascalCaseName
	n = _get_id_name(c)
	if n in seen:
		err = True
	seen=seen | set([n])
	
	str+= "ont:%s a owl:Class ;\n" % (n)
	str+= "\trdfs:subClassOf %s .\n" % (superClass)
if not err:
	OUT = str
else:
	OUT = "Duplicate class names were discovered"
# ----------------------------------------

watch = Watch(create_class)

# group: Write to file
file_path = Filename("..\..\..\..\Downloads\test1.ttl")
writeText = FileSystem.WriteText(filePath=file_path, text=watch)

# group: Generate triples for class assignment
element_namespace = CodeBlock { "http://localhost:3000/duplex/arch/walls/"; }
# note: [0] Class namespace
# [1] Element namespace
# [2] Elements
# [3] Element classes
assign_class = Python(IN[0]=class_namespace, IN[1]=element_namespace, IN[2]=type, IN[3]=all_elements_of_category)
# ---------- assign_class.python (31 lines) ----------
import sys
sys.path.append(r'C:\Program Files (x86)\IronPython 2.7\Lib')
import urllib

#The inputs to this node will be stored as a list in the IN variables.
classNS = 	IN[0]
elementNS = IN[1]
elements = 	IN[2]
classes =	IN[3]

def _get_id_name(e):
	# Make lowercase and replace æ, ø, å
	n = e.Name.lower()
	n = n.replace('æ', 'ae').replace('ø', 'oe').replace('å', 'aa')
	# Make PascalCaseName
	n = ''.join(x for x in n.title() if x.isalnum())
	# URL encode
	n = urllib.quote(n)
	return n

# PREFIXES
str = "@prefix el: <%s> .\n" % elementNS
str+= "@prefix ont: <%s> .\n\n" % classNS

# INSTANCES
for i, e in enumerate(elements):
	cl = classes[i]
	classId = _get_id_name(cl)
	str+= "el:%s a ont:%s .\n" % (e.UniqueId, classId)

OUT = str
# ----------------------------------------

watch_2 = Watch(assign_class)

# group: Write to file
file_path_2 = Filename("..\..\..\..\Downloads\test2.ttl")
writeText_2 = FileSystem.WriteText(filePath=file_path_2, text=watch_2)
