# Dynamo graph class-property-assignment.dyn "class-properties" (Dynamo 2.0.2.6826)

# group: Get element types used in model
categories = Categories(index=589)  # graph input
all_elements_of_category = ElementsOfCategory(Category=categories)
type = archilab.Revit.Elements.Elements.Type(element=all_elements_of_category)
uniqueItems = List.UniqueItems(list=type)

# group: Get property
code_block = CodeBlock { "Width"; }
getParameterValueByName = Element.GetParameterValueByName(element=uniqueItems, parameterName=code_block)

# group: Generate triples
instance_namespace = CodeBlock { "http://localhost:3000/duplex/arch/spaces/"; }
property_namespace = CodeBlock { ["props", "https://w3id.org/props#"]; }
property = CodeBlock { "props:width"; }
datatype_namespace = CodeBlock { ["xsd", "http://www.w3.org/2001/XMLSchema#"]; }
datatype = CodeBlock { "xsd:decimal"; }
# note: [0]Instance namespace
# [1]Property namespace
# [2]Property
# [3]Datatype namespace
# [4]Datatype
# [5]Elements
# [6]Properties
assign_property = Python(IN[0]=instance_namespace, IN[1]=property_namespace, IN[2]=property, IN[3]=datatype_namespace, IN[4]=datatype, IN[5]=uniqueItems, IN[6]=getParameterValueByName)
# ---------- assign_property.python (21 lines) ----------
#The inputs to this node will be stored as a list in the IN variables.
instNS = IN[0]
propPFX = IN[1][0]
propNS = IN[1][1]
prop = IN[2]
dtPFX = IN[3][0]
dtNS = IN[3][1]
dt = IN[4]
elements = IN[5]
properties = IN[6]

# PREFIXES
str = "@prefix inst: <%s> .\n" % instNS
str+= "@prefix %s: <%s> .\n" % (propPFX, propNS)
str+= "@prefix %s: <%s> .\n\n" % (dtPFX, dtNS)

# INSTANCES
for i, e in enumerate(elements):
	str+= 'inst:%s %s "%s"^^%s .\n' % (e.UniqueId, prop, properties[i], dt)

OUT = str
# ----------------------------------------

watch = Watch(assign_property)

# group: Write to file
file_path = Filename("..\..\..\..\..\Downloads\test.ttl")
writeText = FileSystem.WriteText(filePath=file_path, text=watch)
